# Grasshopper definition svg_polylines_example.gh (Grasshopper 0.8.66)

slider = Slider(46.25, range=0..100)
sqgrid = Square(
    Plane=PlaneXY(0, 0, 0),
    Size=Slider(20, range=0..100),
    ExtentX=Slider(20, range=0..100),
    ExtentY=Slider(20, range=0..100))  # -> Cells, Points
slider_2 = Slider(20, range=0..100)
pcen = PolygonCenter(Polyline=flatten(sqgrid.Cells))  # -> CenterV, CenterE
lng = ListLength(List=pcen.CenterV)
random = Random(Range=slider, Number=lng, Seed=Slider(20, range=0..100), Integers=False)
range = Range(Domain=slider, Steps=slider_2)
range_2 = Range(Domain=Domain(0, 1), Steps=slider_2)
Z = UnitZ(Factor=random)
pt = PointXYZ(XComponent=0, YComponent=0, ZComponent=range, System=PlaneXY(0, 0, 0))
shift = ShiftList(List=range_2, Shift=1, Wrap=False)
move = Move(Geometry=pcen.CenterV, Motion=Z)  # -> Geometry, Transform
hsl = ColourHSL(Alpha=1, Hue=Slider(0.513, range=0..1), Saturation=shift, Luminance=Slider(0.351, range=0..1))
xy = XYPlane(Origin=pt)
del = DelaunayMesh(Points=move.Geometry, Plane=PlaneXY(0, 0, 0))
graft = GraftTree(Data=hsl, Strip=False)
sec = MeshPlane(Mesh=del, Plane=xy)
lng_2 = ListLength(List=sec)
crv = Curve(flatten(sec))
preview = CustomPreview(Geometry=sec, Shader=graft)
stack = StackData(Data=graft, Stack=lng_2)
clean = CleanTree(Data=crv, CleanInvalid=True, CleanEmpty=False)
null = NullItem(Item=crv)  # -> NullFlags, InvalidFlags, Description
dispatch = Dispatch(List=flatten(stack), DispatchPattern=null.NullFlags)  # -> ListA, ListB
python = PythonScript(polylines=clean, colors=dispatch.ListB, render=Toggle(True), GhMemory=0)  # -> out, a; inputs polylines: list of Polyline, colors: list of Color, strokes: list, render: Boolean
# ---------- python: Python ----------
try:
    import Rhino
    import scriptcontext
    import System
    GH=True
except:
    GH=False

'''This module is currently just a rough shot for sketching out ideas about svg
export.'''

def _s(o):
    if isinstance(o, str):
        if '_' in o:
            return o.replace('_','-')
        else: return o
    elif isinstance(o, System.Drawing.Color):
        return System.Drawing.ColorTranslator.ToHtml(att)
    else:
        return o

def xml_attributes(**kwargs):
    att_mask = '%s="%s"'
    return ' '.join([att_mask % (_s(k), kwargs[k]) for k in kwargs])

def to_svg(**kwargs):
    tag = kwargs.pop('tag')
    return '<%s %s />' % (tag, xml_attributes(**kwargs))

class svgRenderable(object):
    def render(self):
        if self.tag:
            return to_svg(**vars(self))
        else:
            print 'ERROR: no tag name'
            return

class svgCircle(svgRenderable):
    def __init__(self, cx, cy, r=4):
        self.tag = 'circle'
        self.cx = cx
        self.cy = cy
        self.r = r
        self.fill = 'black'

class svgPath(svgRenderable):
    def __init__(self, coords, color='#000', stroke='1px'):
        self.tag = 'path'
        self.fill = 'none'
        self.stroke = self.parse_color(color)
        self.stroke_width = self.parse_stroke(stroke)
        self.d = self.parse_coords(coords)
    def parse_coords(self, coords):
        coord_pairs = ['%s %s' % (c[0], c[1]) for c in coords]
        return 'M %s' % ' L '.join(coord_pairs)
    def parse_stroke(self, stroke):
        if isinstance(stroke, int) or isinstance(stroke, float):
            return '%spx' % stroke
        else: return stroke
    def parse_color(self, color):
        if isinstance(color, System.Drawing.Color):
            return System.Drawing.ColorTranslator.ToHtml(color)
        else: return color

def viewPoint(point3d, viewport):
    point2d = viewport.WorldToClient(point3d)
    return point2d.X, point2d.Y

def polylineToPath(viewport, polyline, color='#000', stroke='1px'):
    # get points from polyline
    pts = [pt for pt in polyline]
    # convert them to path coords
    coords = [viewPoint(p, viewport) for p in pts]
    path = svgPath(coords, color, stroke)
    return path.render()


def svg_wrap(*args):
    wrapper = '''<svg xmlns="http://www.w3.org/2000/svg" version="1.1">
%s
</svg>'''
    return wrapper % '\n'.join(args)


def test():
    c1 = to_svg(tag='circle', r='10', cx=50, cy=20,
             stroke='#FF0000', fill='#0A0A0A')
    c = svgCircle(30, 70, 15)
    return svg_wrap(c1,c.render())

if GH:
    #if points and fills and radii:
        #circs = []
        #for i, p in enumerate(points):
            #c = svgCircle(p.X, p.Y, radii[i])
            #color = fills[i]
            #hex_color = System.Drawing.ColorTranslator.ToHtml(color)
            #c.fill = hex_color
            #circs.append(c)
        #svgs = [n.render() for n in circs]
        #a = svg_wrap(*svgs)

    if polylines and render:
        outlist = []
        vp = scriptcontext.doc.Views.ActiveView.ActiveViewport
        for i, p in enumerate(polylines):
            outlist.append(polylineToPath(vp, p, colors[i]))
        a = svg_wrap(*outlist)
# ---------- end python ----------
panel = Panel(python.a)
