# Grasshopper definition bcn_example.gh (Grasshopper 0.8.66)

python = PythonScript(folder="C:\Users\benjamin\projects\fulbright\data", GhMemory=-10)  # -> out, a
# ---------- python: Python ----------
import os

def cleanPath(filePath):
    normed = os.path.normpath(filePath)
    return normed

def getShpFiles(folder):
    """this function returns a list of all the
    shapefiles contained within the input folder
    including the subfolders of that folder"""
    shpList = []
    dirTree = os.walk(os.path.abspath(folder))
    for dirTuple in dirTree:
        dirPath = dirTuple[0]
        files = dirTuple[2]
        for f in files:
            if f[-4:] == '.shp':
                shpList.append(os.path.join(dirPath, f))
    return shpList

if folder:
    path = cleanPath(folder)
    files = getShpFiles(path)
    if mask:
        a = [p for p in files if mask in p]
    else:
        a = files
# ---------- end python ----------
readshapefile = PythonScript(shapefile=python.a, read=Toggle(False), moveToCenter=Toggle(False), GhMemory=0)  # -> out, geometry; inputs shapefile: String, read: Boolean, moveToCenter: Boolean
# ---------- readshapefile: Python ----------
#import Rhino
import os
import sys

# edit sys.path
package = '~/projects/finches/'
expanded = os.path.abspath(os.path.expanduser(package))
if expanded not in sys.path:
    sys.path.append(expanded)

decom = [
    'Shp',
    'ShpFeature',
    'ShpToRhino',
    ]
for m in decom:
    if m in sys.modules:
        del sys.modules[m]

# get the module
import Shp
import ShpFeature
import ShpToRhino


if read:
    if shapefile:
        if not os.path.exists(shapefile):
            print 'The shapefile you gave me does not exist.\nDouble check the path: "%s"' % shapefile
        # import stuff
        out = ShpToRhino.ShpFileToRhino( shapefile, moveToCenter )
        geometry = out
    else:
        print 'no shapefile supplied'
# ---------- end readshapefile ----------
crv = Curve([<curve referenced from the Rhino model> x430])
extractuserstrings = PythonScript(geometry=crv, GhMemory=0)  # -> out, U, K, V; inputs key: String
# ---------- extractuserstrings: Python ----------
if geometry:
    data = geometry.GetUserStrings()
    d = {}
    k = []
    v = []
    for u in data:
        k.append(u)
        d[u] = data[u]
        v.append(d[u])
    U = d
    K = k
    V = v
# ---------- end extractuserstrings ----------
item = ListItem(List=extractuserstrings.V, Index=Slider(4, range=0..15), Wrap=False)
multiplication = Multiplication(A=Slider(0.1, range=0..100), B=item)
Z = UnitZ(Factor=flatten(multiplication))
move = Move(Geometry=crv, Motion=Z)  # -> Geometry, Transform
sort = SortList(Keys=flatten(multiplication), ValuesA=move.Geometry)  # -> Keys, ValuesA
crv_2 = Curve(sort.ValuesA)
python_2 = PythonScript(geometry=crv_2, DataComparison="shortest_list", GhMemory=0)  # -> out, dictionary
# ---------- python_2: Python ----------
class GhPythonDictionary(object):
    def __init__(self, pythonDict=None):
        if pythonDict:
            self.d = pythonDict
        else:
            self.d = {}
    def ToString(self):
        return '<GhPythonDictionary keys: %s>' % len(self.d.keys())
        
        
if geometry:
    data = geometry.GetUserStrings()
    ghPyD = GhPythonDictionary()
    for key in data:
        value = data[key] #whitespace problems?
        ghPyD.d[key] = value
    dictionary = ghPyD
# ---------- end python_2 ----------
python_3 = PythonScript(dictionary=python_2.dictionary, GhMemory=0)  # -> out, keys, values
# ---------- python_3: Python ----------
if dictionary:
    keys = dictionary.d.keys()
    values = dictionary.d.values()
# ---------- end python_3 ----------
python_4 = PythonScript(key="class", value="parcel", GhMemory=0)  # -> out, dictionary
# ---------- python_4: Python ----------
class GhPythonDictionary(object):
    def __init__(self, pythonDict=None):
        if pythonDict:
            self.d = pythonDict
        else:
            self.d = {}
    def ToString(self):
        return '<GhPythonDictionary keys: %s>' % len(self.d.keys())


if key and value:
    dictionary = GhPythonDictionary({key:value})
# ---------- end python_4 ----------
js = FilePath("C:\Users\benjamin\projects\gh-svg\tests\bcn_example.js")
css = FilePath("C:\Users\benjamin\projects\gh-svg\tests\bcn_example.css")
file = ReadFile(Path=js, Lines=Toggle(False))
file_2 = ReadFile(Path=css, Lines=Toggle(False))
panel = Panel(python_3.keys)
weave = Weave(Pattern=[0, 1], Stream0=graft(python_2.dictionary), Stream1=graft(python_4.dictionary), NullGaps=False)
mergedict = PythonScript(D=weave, GhMemory=0)  # -> out, M; inputs D: list
# ---------- mergedict: Python ----------
class GhPythonDictionary(object):
    def __init__(self, pythonDict=None):
        if pythonDict:
            self.d = pythonDict
        else:
            self.d = {}
    def ToString(self):
        return '<GhPythonDictionary keys: %s>' % len(self.d.keys())

if D:
    full = GhPythonDictionary()
    for gh_dict in D:
        full.d.update(gh_dict.d)
    M = full
# ---------- end mergedict ----------
flatten = FlattenTree(Data=mergedict.M, Path="{0}")
python_5 = PythonScript(
    geometry=crv_2,
    create_svg=Toggle(False),
    attribute_dictionaries=flatten,
    polyline_tol=Slider(0.01, range=0..0.1),
    title="SVG Export Example From Grassopper",
    css=file_2,
    js=file,
    GhMemory=0)  # -> out, svg_text; inputs geometry: list, attribute_dictionaries: list
# ---------- python_5: Python ----------
try:
    import Rhino
    import scriptcontext
    import System
    GH=True
except:
    GH=False

'''This module is currently just a rough shot for sketching out ideas about svg
export.'''

def conversion_lookup(g):
    if isinstance(g, Rhino.Geometry.Point3d):
        return to_svg_point
    elif isinstance(g, Rhino.Geometry.Polyline):
        return to_svg_polyline
    elif isinstance(g, Rhino.Geometry.PolylineCurve):
        return to_svg_polyline
    elif isinstance(g, Rhino.Geometry.Curve):
        return to_svg_curve
    else:
        try:
            to_svg_curve
        except:
            print 'This geometry could not be converted:'
            print type(g)
            raise

def to_svg_point(vp, g, atts):
    x, y = viewPoint(g, vp)
    return svgCircle(x,y)

def to_svg_polyline(vp, g, atts):
    polyline = g.TryGetPolyline()[1]
    # get points from polyline
    pts = [pt for pt in polyline]
    # convert them to path coords
    coords = [viewPoint(p, vp) for p in pts]
    return svgPolyline(coords, atts)

def to_svg_curve(vp, g, atts):
    poly = g.ToPolyline(0,0,0.01, 0.1, tol, 0, 0, True, g.Domain)
    return to_svg_polyline(vp, poly, atts)

def viewPoint(point3d, viewport):
    point2d = viewport.WorldToClient(point3d)
    return point2d.X, point2d.Y


def xml_attributes(**kwargs):
    att_mask = '%s="%s"'
    atts = []
    for key in ('id', 'class'):
        if key in kwargs:
            atts.append((key, kwargs.pop(key)))
    for k in kwargs:
        atts.append((k, kwargs[k]))
    return ' '.join([att_mask % a for a in atts])

def to_svg(**kwargs):
    tag = kwargs.pop('tag')
    return '<%s %s />' % (tag, xml_attributes(**kwargs))

class svgRenderable(object):
    def render(self):
        if self.tag:
            d = vars(self)
            # blend attributes into dictionary
            d.update(d.pop('attributes'))
            return to_svg(**d)
        else:
            print 'ERROR: no tag name'
            return

class svgCircle(svgRenderable):
    def __init__(self, cx, cy, attributes):
        self.tag = 'circle'
        self.cx = cx
        self.cy = cy
        self.attributes = attributes

class svgPolyline(svgRenderable):
    def __init__(self, coords, attributes):
        self.tag = 'path'
        self.d = self.parse_coords(coords)
        self.attributes = attributes
    def parse_coords(self, coords):
        coord_pairs = ['%s %s' % (c[0], c[1]) for c in coords]
        return 'M %s' % ' L '.join(coord_pairs)

def svg_wrap(svgs):
    wrapper = '''<svg xmlns="http://www.w3.org/2000/svg" version="1.1">
%s
</svg>'''
    return wrapper % '\n'.join(svgs)

def html_wrap(svg, title='Grasshopper Export', css='', js=''):
    wrapper = '''
<html lang="en">
    <head>
        <meta charset="UTF-8">
        <title>%s</title>
        <style type="text/css">
        %s
        </style>
    </head>
    <body>
        <div id="container">
        %s
        </div>
        %s
    </body>
</html>'''
    return wrapper % (title, css, svg_wrap(svg), js)

def build_svg_text(geometry, atts, viewport):
    out = []
    for i, g in enumerate(geometry):
        svg = conversion_lookup(g)(viewport, g, atts[i])
        txt = svg.render()
        out.append(txt)
    return out

if GH:
    '''This part only runs if this code is pasted in a Grasshopper python
    component.
    '''
    if geometry and create_svg:
        # run the script
        if attribute_dictionaries:
            # unwrap the attribute dictionaries, just get their normal
            # dictionaries
            atts = [a.d for a in attribute_dictionaries]
        else:
            atts = []
        if not viewport:
            viewport = scriptcontext.doc.Views.ActiveView.ActiveViewport
        tol = polyline_tol
        svg_text = html_wrap(build_svg_text(geometry, atts, viewport), title, css, js)
# ---------- end python_5 ----------
panel_2 = Panel(python_5.svg_text)
