# Grasshopper definition svg_multi_test.gh (Grasshopper 0.8.66)

range = Range(Domain=Domain(0, 1), Steps=Slider(13, range=0..100))
graph = GraphMapper(
    range,
    x0=0,
    x1=1,
    y0=0,
    y1=1,
    container_name="Bezier",
    cpx=[0, 0.1283782125, 0.6604726315, 1],
    cpy=[0, 0.9184783101, 0.1372283697, 1])
graph_2 = GraphMapper(
    range,
    x0=0,
    x1=1,
    y0=0,
    y1=1,
    container_name="Sinc",
    Equation_X0=0.08614848554,
    Equation_Y0=0.6716488004,
    Equation_X1=0.5175673962,
    Equation_Y1=0.3192937076)
graph_3 = GraphMapper(range, x0=0, x1=1, y0=0, y1=1, container_name="Sine", Equation_px=[0, 0.5081080794], Equation_py=[0, 0.8623188138])
weave = Weave(Pattern=[0, 1, 2], Stream0=graft(graph), Stream1=graft(graph_2), Stream2=graft(graph_3), NullGaps=False)
lng = ListLength(List=weave)  # -> flatten(Length)
remap = RemapNumbers(Values=weave, Source=Domain(0, 1), Target=Slider(0.213, range=0..1))
flip = FlipMatrix(Data=remap)
item = ListItem(List=lng, Index=0, Wrap=False)
dom = Domain(DomainStart=Slider(0.053, range=0..1), DomainEnd=Slider(0.24, range=0..1))
range_2 = Range(Domain=Domain(0, 1), Steps=expr("N-1", item))  # -> graft(Range)
slider = Slider(39, range=0..100)
pt = PointXYZ(XComponent=range, YComponent=range_2, ZComponent=flip, System=PlaneXY(0, 0, 0))
random = Random(Range=Slider(93, range=0..100), Number=Slider(4, range=0..10), Seed=Slider(37, range=0..100), Integers=True)
intcrv = Interpolate(Vertices=pt, Degree=3, Periodic=False)  # -> Curve, Length, Domain
dispatch = Dispatch(List=random, DispatchPattern=[True, False])  # -> ListA, ListB
random_2 = Random(Range=dom, Number=slider, Seed=dispatch.ListB, Integers=False)
random_3 = Random(Range=Domain(0, 1), Number=slider, Seed=dispatch.ListA, Integers=False)
flip_2 = FlipMatrix(Data=random_2)
flip_3 = FlipMatrix(Data=random_3)
loft = Loft(
    Curves=flatten(intcrv.Curve),
    Options={Adjust=False, Closed=False, Rebuild=10, Refit=0.01, LoftType=0, LoftEnds=0, LoftSimp=0})
dispatch_2 = Dispatch(List=flip_2, DispatchPattern=[True, False])  # -> ListA, ListB
dispatch_3 = Dispatch(List=flip_3, DispatchPattern=[True, False])  # -> ListA, ListB
addition = Addition(A=dispatch_3.ListA, B=dispatch_2.ListA)
addition_2 = Addition(A=dispatch_3.ListB, B=dispatch_2.ListB)
dom_2 = Domain(DomainStart=dispatch_3.ListA, DomainEnd=addition)
dom_3 = Domain(DomainStart=dispatch_3.ListB, DomainEnd=addition_2)
dom² = Domain²(DomainU=dom_2, DomainV=dom_3)
subsrf = Isotrim(Surface=reparameterize(loft), Domain=flatten(dom²))
panel = Panel("""small
smallish
medium
biggish
big""")
area = Area(Geometry=subsrf)  # -> Area, Centroid
sort = SortList(Keys=area.Area, ValuesA=subsrf)  # -> Keys, ValuesA
lng_2 = ListLength(List=panel)
bnd = Bounds(Numbers=sort.Keys)
div = DivideDomain(Domain=bnd, Count=lng_2)
rev = ReverseList(List=sort.Keys)
rev_2 = ReverseList(List=sort.ValuesA)
panel_2 = Panel("La Terra es formà com a part del naixement del sistema solar; el que més tard esdevindria el sistema solar existia inicialment com un gran núvol de pols, roques i gasos en rotació. Estava compost d'hidrogen i heli produïts al Big Bang , així com d'elements químics expulsats per les explosions de les supernoves. Aleshores, fa uns 4.600 milions d'anys, es pensa que una estrella propera esdevingué una supernova. L'explosió envià una ona expansiva a través de la nebulosa presolar, causant-ne la implosió. A mesura que el núvol continuava rotant, la gravetat i la inèrcia l'aplanaren en un disc protoplanetari, orientat perpendicularment respecte al seu eix de rotació. La majoria de la massa es concentrà al centre i començà a escalfar-se. La implosió d'aquesta matèria donà calor cinètica; com que no es podia escapar, el centre del núvol s'escalfà, permetent la fusió d'hidrogen en heli. El resultat fou un estel T Tauri, el Sol primitiu. Mentrestant, a mesura que la gravetat feia que la matèria es condensés al voltant de les partícules de pols, la resta del disc es començà a separar en anells. Els fragments més petits col·lidien i es tornaven fragments més grans, que esdevenien protoplanetes.[1] Entre ells hi hagué una acumulació de matèria a uns 150 milions de quilòmetres del centre: la Terra. A mesura que el Sol es condensava i s'escalfava, començà a produir-se la fusió nuclear, i el vent solar que en resultà s'endugué la majoria del material del disc que no s'havia condensat en cossos més grans.")
explode = BrepComponents(Brep=rev_2)  # -> Faces, Edges, Vertices
fdom = FindDomain(Domains=div, Number=rev, Strict=False)  # -> Index, Neighbour
join = JoinCurves(Curves=explode.Edges, Preserve=False)
python = PythonScript(x=panel_2, GhMemory=0)  # -> out, a, b
# ---------- python: Python ----------
if x:
    sentences = [s + '.' for s in x.strip().split('. ')]
    words = x.split()
    
    a = words[:len(sentences)]
    b = sentences
# ---------- end python ----------
lng_3 = ListLength(List=<missing>)
series = Series(Start=0, Step=1, Count=lng_3)
item_2 = ListItem(List=panel, Index=fdom.Index, Wrap=False)
int = Integer(series)
python_2 = PythonScript(key="text", value=python.b, GhMemory=0)  # -> out, dictionary
# ---------- python_2: Python ----------
class GhPythonDictionary(object):
    def __init__(self, pythonDict=None):
        if pythonDict:
            self.d = pythonDict
        else:
            self.d = {}
    def ToString(self):
        return '<GhPythonDictionary keys: %s>' % len(self.d.keys())


if key and value:
    dictionary = GhPythonDictionary({key:value})
# ---------- end python_2 ----------
concat = Concatenate(Start="area_", End=int)
python_3 = PythonScript(key="class", value=item_2, GhMemory=0)  # -> out, dictionary; same code as python_2
python_4 = PythonScript(key="id", value=concat, GhMemory=0)  # -> out, dictionary; same code as python_2
weave_2 = Weave(
    Pattern=[0, 1, 2],
    Stream0=graft(python_3.dictionary),
    Stream1=graft(python_4.dictionary),
    Stream2=graft(python_2.dictionary),
    NullGaps=False)
mergedict = PythonScript(D=weave_2, GhMemory=0)  # -> out, M; inputs D: list
# ---------- mergedict: Python ----------
class GhPythonDictionary(object):
    def __init__(self, pythonDict=None):
        if pythonDict:
            self.d = pythonDict
        else:
            self.d = {}
    def ToString(self):
        return '<GhPythonDictionary keys: %s>' % len(self.d.keys())

if D:
    full = GhPythonDictionary()
    for gh_dict in D:
        full.d.update(gh_dict.d)
    M = full
# ---------- end mergedict ----------
attribute_dictionary = Data(flatten(mergedict.M))
item_3 = ListItem(List=<missing>, Index=0, Wrap=False)
python_5 = PythonScript(
    geometry=<missing>,
    create_svg=Toggle(False),
    attribute_dictionaries=attribute_dictionary,
    polyline_tol=Slider(0.01, range=0..0.1),
    GhMemory=0)  # -> out, svg_text; inputs geometry: list, attribute_dictionaries: list, polyline_tol: Double
# ---------- python_5: Python ----------
if geometry and create_svg:
    pass
# ---------- end python_5 ----------
python_6 = PythonScript(crv=item_3, dTol=Slider(0.13, range=0..1), kTol=Slider(0.12, range=0..1), GhMemory=0)  # -> out, a
# ---------- python_6: Python ----------
import Rhino


if crv:
    tol = 0.010
    p = crv.ToPolyline(0,0,0.01, 0.1, tol, 0, 0, True, crv.Domain)
    a = p
# ---------- end python_6 ----------
